# Dynamo graph PDFCreator.dyn "PDFcreatortoolv1.3.1" (Dynamo 2.0.2.6826)

# group: Usage Notes
# note: Script Version: 1.3.1
# Dynamo Version: 2.0.2
# Author: Paul Fassnidge
# Date: 23/04/19
# Contact: paulfassnidge@hydrock.com
# Released Notes: Variant of 1.3 with Sheet Number rather than Sub Package used to differentiate sheets in pop up selector.
# Packages Used:
# ArchiLab, Data-Shapes, Genius Loci
# Instructions:
# IMPORTANT - PLEASE CLOSE AND REOPEN DYNAMO SCRIPT AFTER EACH RUN FOR BEST PERFORMANCE
# SET BLUEBEAM AS YOUR DEFAULT PDF PRINTER AND READER
# 1) In the blue boxes select the same directory as your current Bluebeam output folder for the PDFs to be sent to
# 2) Run the script and select your chosen sheets from the pop up window and press select.
# 3) PDF sheets should now be in your chosen folder

# group: User inputs
pdf_s_will_be_sent_to_folder_set = Directory("C:\Users\paulfassnidge\Documents\test_print")  # "PDF's will be sent to folder set in your Bluebeam settings"; graph input
print_settings = PrintSettingUi(index=0)  # graph input

# group: UI Select Sheets
code_block = CodeBlock { "BPE PDF Generator"; }
file_path = Filename("..\..\..\OneDrive - Hydrock Consultants Ltd\BPE_Labs\bpe_labs.jpg")
code_block_2 = CodeBlock { "Select Sheets"; }
code_block_3 = CodeBlock { Category.ByName(["Sheets"]); }
all_elements_of_category = ElementsOfCategory(Category=code_block_3)
flatten = List.Flatten(list=all_elements_of_category)
code_block_4 = CodeBlock { "Sheet Number"; }
getParameterValueByName = Element.GetParameterValueByName(element=flatten, parameterName=code_block_4)
code_block_5 = CodeBlock { "Sheet Name"; }
getParameterValueByName_2 = Element.GetParameterValueByName(element=flatten, parameterName=code_block_5)
code_block_6 = CodeBlock(list1=getParameterValueByName, list2=getParameterValueByName_2) { list1 + "-" + list2; }
boolean = BoolSelector(false)
ui_listview_data = Custom[UI.Listview Data](InputName=code_block_2, Keys_var=code_block_6, Values_var=flatten, ShowId_optionnal=boolean)  # Create data for ListView input in UI.MultiInputForm ++ . Check out www.data-shapes.net for more infos.
boolean_2 = BoolSelector(true)
code_block_7 = CodeBlock { "Cancel"; }
code_block_8 = CodeBlock { 800; }
ui_multipleinputform = Custom[UI.MultipleInputForm ++](Description_optional=code_block, Logo_optional=file_path, Inputs=ui_listview_data, Toggle=boolean_2, CancelButtonText_optional=code_block_7, Width_optional=code_block_8)  # Create a form with multiple inputs. see www.data-shapes.net for tutorials and infos!

# group: Get naming Params
code_block_9 = CodeBlock { "File Name - Project Code"; }
getParameterValueByName_3 = Element.GetParameterValueByName(element=ui_multipleinputform.User_Inputs, parameterName=code_block_9)
code_block_10 = CodeBlock { "File Name - Originator"; }
getParameterValueByName_4 = Element.GetParameterValueByName(element=ui_multipleinputform.User_Inputs, parameterName=code_block_10)
code_block_11 = CodeBlock { "File Name - Zone"; }
getParameterValueByName_5 = Element.GetParameterValueByName(element=ui_multipleinputform.User_Inputs, parameterName=code_block_11)
code_block_12 = CodeBlock { "File Name - Level"; }
getParameterValueByName_6 = Element.GetParameterValueByName(element=ui_multipleinputform.User_Inputs, parameterName=code_block_12)
code_block_13 = CodeBlock { "File Name - Type"; }
getParameterValueByName_7 = Element.GetParameterValueByName(element=ui_multipleinputform.User_Inputs, parameterName=code_block_13)
code_block_14 = CodeBlock { "File Name - Role"; }
getParameterValueByName_8 = Element.GetParameterValueByName(element=ui_multipleinputform.User_Inputs, parameterName=code_block_14)
sheetNumber = Sheet.SheetNumber(sheet=ui_multipleinputform.User_Inputs)
sheetName = Sheet.SheetName(sheet=ui_multipleinputform.User_Inputs)

# group: Concat name details
code_block_15 = CodeBlock(list1=getParameterValueByName_3, list2=getParameterValueByName_4, list3=getParameterValueByName_5, list4=getParameterValueByName_6, list5=getParameterValueByName_7, list6=getParameterValueByName_8, list7=sheetNumber, list8=sheetName) { list1 + "-" + list2 + "-" + list3 + "-" + list4 + "-" + list5 + "-" + list6 + "-" + list7 + "-" + list8; }
list_create = List.Create(item0=[code_block_15, code_block_15])
additionals = CodeBlock { ""; ""; }
string_from_list = Custom[String From List](List=list_create@L2, Suffix=additionals.out0, Seperator=additionals.out1)  # This node will take an input of a list or nested list and then join each element in a list with a given seperator while adding a suffix.

# group: Write PDFs
filenameToFilePaths = Custom[FilenameToFilePaths](Directory_Path=pdf_s_will_be_sent_to_folder_set, Filenames=string_from_list)  # Add directory and .pdf extension to filenames.
list_create_2 = List.Create(item0=filenameToFilePaths)
flatten_2 = List.Flatten(list=list_create_2)
list_create_3 = List.Create(item0=ui_multipleinputform.User_Inputs)
flatten_3 = List.Flatten(list=list_create_3)
string = StringInput("Bluebeam PDF")
print_range = StringInput("Select")
boolean_3 = BoolSelector(true)
print_pdf_multiple_formats = Custom[Print PDF (multiple formats)](FilePaths=flatten_2, Views=flatten_3, PrintSetting=print_settings, PrinterName=string, PrintRange=print_range, RunIt=boolean_3)  # This node will allow you to initiate a printing routine from a set of views/sheets, filename, printer name, print settings with many formats and print range. Use MergePDFs node to combine files. From archilab.
are_your_files_created = Watch(print_pdf_multiple_formats)

# group: Data
python_script = Python()  # unwired: IN[0]
# ---------- python_script.python (22 lines) ----------
#BPE data metrics by PF

import clr
import System
from System.IO import Directory

import sys
# load python
pyt_path = r'C:\Program Files (x86)\IronPython 2.7\Lib'
sys.path.append(pyt_path)

from datetime import datetime

project = IN[0]

# get the current date and time
starttime = datetime.now().strftime("%H-%M-%S")

import os
   

OUT = starttime
# ----------------------------------------
control = CodeBlock(passthrough=are_your_files_created, waitfor=python_script) { [passthrough,waitfor][0]; }
python_script_2 = Python(IN[0]=control)
# ---------- python_script_2.python (35 lines) ----------
#Get project info by PF

import clr
clr.AddReference("RevitServices")
clr.AddReference('DynamoRevitDS')
import RevitServices
from RevitServices.Persistence import DocumentManager

import Dynamo 
import sys
sys.path.append(r'C:\Program Files (x86)\IronPython 2.7\Lib')

import os
DynamoRevit=Dynamo.Applications.DynamoRevit()

passthrough = IN[0]

#Get doc and dynamo stuff
doc = DocumentManager.Instance.CurrentDBDocument
app = DocumentManager.Instance.CurrentUIApplication.Application
scriptname=DynamoRevit.RevitDynamoModel.CurrentWorkspace.FileName

name=os.path.basename(scriptname)

filename,extention=os.path.splitext(name)

elementlist = list()
projinfo = doc.ProjectInformation

elementlist.append(projinfo.Name)
elementlist.append(projinfo.Number)
elementlist.append(app.Username)
elementlist.append(filename)

OUT = elementlist
# ----------------------------------------
control_2 = CodeBlock(seq=python_script_2) { seq[0]; seq[1]; seq[2]; seq[3]; }
python_script_3 = Python(IN[0]=control_2.out0, IN[1]=control_2.out1, IN[2]=control_2.out2, IN[3]=control_2.out3, IN[4]=python_script)
# ---------- python_script_3.python (42 lines) ----------
#BPE data metrics by PF

import clr
import System
from System.IO import Directory

import sys
# load python
pyt_path = r'C:\Program Files (x86)\IronPython 2.7\Lib'
sys.path.append(pyt_path)

from datetime import datetime

project = IN[0]
number = IN[1]
user = IN[2]
scriptname = IN[3]
starttime = IN[4]


# get the current date and time
datestamp = datetime.today().strftime("%Y-%m-%d")
endtime = datetime.now().strftime("%H-%M-%S")

#runtime = (endtime - starttime)
#runtime.seconds

import os

## set the output directory and gather log data
dir = 'Q:\Office\IT Software\Dynamo\data'
   
# create a directory for each user of a machine
Directory.CreateDirectory(dir)

# generate the file name for the log file
filename = (str(datestamp) + '_' +str(endtime) + '_' +str(project) + '_' +str(number) + '_' +str(scriptname) + '_' +str(starttime) + '_' +str(user) + '_' + '.txt')

# create the log file (blank text file)
logger = open(dir + '\\' + filename,'w+')

OUT = str("Run Logged")
# ----------------------------------------
