# Dynamo graph publishertool.dyn (Dynamo 2.0.3.8810)

# group: Usage Notes
# note: Script Version: 1.4.6
# Dynamo Version: 2.0.2+
# Author: Paul Fassnidge
# Date: 25/09/20
# Contact: paulfassnidge@hydrock.com
# Released Notes:
# Add Destination Folder Path to UI
# Packages Used:
# Data-Shapes version: 2019.2.42

# group: USER INPUTS
# note: USED:
# FOR USER SELECTIONS, SETTINGS AND GRAPH VARIABLES

# group: CREATE IN REVIT
# note: USED:
# FOR THE CREATION OF ELEMENTS IN THE REVIT WORKSPACE

# group: GET DATA
# note: USED:
# FOR THE DISCOVERY AND RETRIVAL OF INFORMATION

# group: WRITE DATA
# note: USED:
# FOR INSTANCES WHICH CREATE  AND EXPORT DATA TO REVIT OR EXTERNAL SOFTWARES/DIRECTORIES

# group: GRAPH PROCESS COLOR CODING
# note: DYNAMO GRAPHIC STANDARDS APPLIED

# group: CREATE IN DYNAMO
# note: USED:
# IN CREATION OR ADAPTATION OF GEOMETRY IN THE DYNAMO WORKSPACE

# group: PROCESS DATA
# note: USED:
# AS A GENERAL DEFINITION FOR CASES OF DATA PROCESSING

# group: User UI
code_block = CodeBlock { "HDT Publisher Tool"; }
code_block_2 = CodeBlock { "Print"; }
code_block_3 = CodeBlock { "Printer Name"; }
code_block_4 = CodeBlock { "Bluebeam PDF"; }
code_block_5 = CodeBlock { 0; }
data_shapes_radiobuttons_data = Custom[Data-Shapes_RadioButtons Data](InputName=code_block_3, Keys=code_block_4, Values=code_block_4, DefaultValueIndex=code_block_5)  # Create radio buttons input for UI.MultipleInputForm ++ .
code_block_6 = CodeBlock { "Select Print Setting (Note: Select Default if unsure)"; }
get_document = Python()
# ---------- get_document.python (29 lines) ----------
# Copyright(c) 2015, Konrad K Sobon
# @arch_laboratory, http://archi-lab.net

# Import DocumentManager
import clr
clr.AddReference("RevitServices")
import RevitServices
from RevitServices.Persistence import DocumentManager

import sys
pyt_path = r'C:\Program Files (x86)\IronPython 2.7\Lib'
sys.path.append(pyt_path)

#The inputs to this node will be stored as a list in the IN variable.
dataEnteringNode = IN

try:
	errorReport = None
	doc = DocumentManager.Instance.CurrentDBDocument
except:
	# if error accurs anywhere in the process catch it
	import traceback
	errorReport = traceback.format_exc()

#Assign your output to the OUT variable
if errorReport == None:
	OUT = doc
else:
	OUT = errorReport
# ----------------------------------------
pass_through = CodeBlock(out=get_document) { _out; }
printsettings = Python(IN[0]=pass_through)
# ---------- printsettings.python (27 lines) ----------
#Copyright(c) 2015, Konrad Sobon
# @arch_laboratory, http://archi-lab.net

import clr

clr.AddReference("RevitServices")
import RevitServices
from RevitServices.Persistence import DocumentManager

clr.AddReference("RevitAPI")
import Autodesk
from Autodesk.Revit.DB import *

inputdoc = UnwrapElement(IN[0])

#Part of script from Clockwork
if inputdoc == None:
	doc = DocumentManager.Instance.CurrentDBDocument
elif inputdoc.GetType().ToString() == "Autodesk.Revit.DB.RevitLinkInstance":
	doc = inputdoc.GetLinkDocument()
elif inputdoc.GetType().ToString() == "Autodesk.Revit.DB.Document":
	doc = inputdoc
else: doc = None

ps = FilteredElementCollector(doc).OfClass(PrintSetting)

OUT = [i for i in ps],[i.Name for i in ps]
# ----------------------------------------
code_block_7 = CodeBlock(x=printsettings) { x[0]; x[1]; }
code_block_8 = CodeBlock(PrintsettingName=code_block_7.out1) { PrintsettingName; }
code_block_9 = CodeBlock(Printsetting=code_block_7.out0) { Printsetting; }
data_shapes_ui_radiobuttons_data = Custom[Data-Shapes_UI.RadioButtons Data](InputName=code_block_6, Keys=code_block_8, Values=code_block_9)  # Create radio buttons input for UI.MultipleInputForm ++ .
code_block_10 = CodeBlock { "Filename Format Contains"; }
code_block_11 = CodeBlock { true; }
code_block_12 = CodeBlock { "Sheet Number"; }
data_shapes_ui_boolean_input = Custom[Data-Shapes_UI.Boolean input](InputName=code_block_10, DefaultValue=code_block_11, SideText=code_block_12)  # Creates a boolean input for UI.MultipleInputForm ++ . Check out www.data-shapes.net for more infos!
code_block_13 = CodeBlock { false; }
code_block_14 = CodeBlock { "Sheet Name"; }
data_shapes_ui_boolean_input_2 = Custom[Data-Shapes_UI.Boolean input](DefaultValue=code_block_13, SideText=code_block_14)
code_block_15 = CodeBlock { false; }
code_block_16 = CodeBlock { "Revision"; }
data_shapes_ui_boolean_input_3 = Custom[Data-Shapes_UI.Boolean input](DefaultValue=code_block_15, SideText=code_block_16)
code_block_17 = CodeBlock { false; }
code_block_18 = CodeBlock { "Status Code"; }
data_shapes_ui_boolean_input_4 = Custom[Data-Shapes_UI.Boolean input](DefaultValue=code_block_17, SideText=code_block_18)
code_block_19 = CodeBlock { "Select File Format Required"; }
code_block_20 = CodeBlock { false; }
code_block_21 = CodeBlock { "PDF"; }
data_shapes_ui_boolean_input_5 = Custom[Data-Shapes_UI.Boolean input](InputName=code_block_19, DefaultValue=code_block_20, SideText=code_block_21)
code_block_22 = CodeBlock { false; }
code_block_23 = CodeBlock { "DWG"; }
data_shapes_ui_boolean_input_6 = Custom[Data-Shapes_UI.Boolean input](DefaultValue=code_block_22, SideText=code_block_23)
code_block_24 = CodeBlock { "Select Sheets"; }
get_document_2 = Python()  # same code as get_document
get_sheets = Python(IN[0]=get_document_2)
# ---------- get_sheets.python (24 lines) ----------
import clr
clr.AddReference('RevitAPI')
from Autodesk.Revit.DB import *
import Autodesk

clr.AddReference("RevitServices")
import RevitServices
from RevitServices.Persistence import DocumentManager

inputdoc = UnwrapElement(IN[0])
if inputdoc == None:
	doc = DocumentManager.Instance.CurrentDBDocument
elif inputdoc.GetType().ToString() == "Autodesk.Revit.DB.RevitLinkInstance":
	doc = inputdoc.GetLinkDocument()
elif inputdoc.GetType().ToString() == "Autodesk.Revit.DB.Document":
	doc = inputdoc
else: doc = None

collector = FilteredElementCollector(doc)
views = collector.OfClass(ViewSheet).ToElements()
viewlist = list()
for view in views:
	viewlist.append(view)
OUT = viewlist
# ----------------------------------------
flatten = List.Flatten(list=get_sheets)
code_block_25 = CodeBlock { "Sheet Number"; }
getParameterValueByName = Element.GetParameterValueByName(element=flatten, parameterName=code_block_25)
code_block_26 = CodeBlock { "Sheet Name"; }
getParameterValueByName_2 = Element.GetParameterValueByName(element=flatten, parameterName=code_block_26)
code_block_27 = CodeBlock { "Revision"; }
getParameterValueByName_3 = Element.GetParameterValueByName(element=flatten, parameterName=code_block_27)
code_block_28 = CodeBlock { "Status Code"; }
getParameterValueByName_4 = Element.GetParameterValueByName(element=flatten, parameterName=code_block_28)
code_block_29 = CodeBlock(list1=getParameterValueByName, list2=getParameterValueByName_2, list3=getParameterValueByName_3, list4=getParameterValueByName_4) { list1 + "-" + list2 + "-" + list3 + "-" + list4; }
code_block_30 = CodeBlock { false; }
data_shapes_ui_listview_data = Custom[Data-Shapes_UI.Listview Data](InputName=code_block_24, Keys=code_block_29, Values=flatten, ShowId_optionnal=code_block_30)  # Create data for ListView input in UI.MultiInputForm ++ . Check out www.data-shapes.net for more infos.
list_create = List.Create(item0=data_shapes_radiobuttons_data, item1=data_shapes_ui_radiobuttons_data, item2=data_shapes_ui_boolean_input, item3=data_shapes_ui_boolean_input_2, item4=data_shapes_ui_boolean_input_3, item5=data_shapes_ui_boolean_input_4, item6=data_shapes_ui_boolean_input_5, item7=data_shapes_ui_boolean_input_6, item8=data_shapes_ui_listview_data)
code_block_31 = CodeBlock { true; }
code_block_32 = CodeBlock { "Cancel"; }
code_block_33 = CodeBlock { 800; }
data_shapes_ui_multipleinputform = Custom[Data-Shapes_UI.MultipleInputForm ++](Description_optional=code_block, ButtonText_optional=code_block_2, Inputs=list_create, Toggle=code_block_31, CancelButtonText_optional=code_block_32, MaxHeight_optional=code_block_33, Width_optional=code_block_33)  # Create a form with multiple inputs. see www.data-shapes.net for tutorials and infos!

# group: Sort Input Data
code_block_34 = CodeBlock { 8; }
getItemAtIndex = List.GetItemAtIndex(list=data_shapes_ui_multipleinputform.User_Inputs, index=code_block_34)
code_block_35 = CodeBlock { 0; }
getItemAtIndex_2 = List.GetItemAtIndex(list=data_shapes_ui_multipleinputform.User_Inputs, index=code_block_35)
code_block_36 = CodeBlock { 1; }
getItemAtIndex_3 = List.GetItemAtIndex(list=data_shapes_ui_multipleinputform.User_Inputs, index=code_block_36)
flatten_2 = List.Flatten(list=getItemAtIndex_3)
code_block_37 = CodeBlock { 2; }
getItemAtIndex_4 = List.GetItemAtIndex(list=data_shapes_ui_multipleinputform.User_Inputs, index=code_block_37)
code_block_38 = CodeBlock { 3; }
getItemAtIndex_5 = List.GetItemAtIndex(list=data_shapes_ui_multipleinputform.User_Inputs, index=code_block_38)
code_block_39 = CodeBlock { 4; }
getItemAtIndex_6 = List.GetItemAtIndex(list=data_shapes_ui_multipleinputform.User_Inputs, index=code_block_39)
code_block_40 = CodeBlock { 5; }
getItemAtIndex_7 = List.GetItemAtIndex(list=data_shapes_ui_multipleinputform.User_Inputs, index=code_block_40)
list_create_2 = List.Create(item0=getItemAtIndex_4, item1=getItemAtIndex_5, item2=getItemAtIndex_6, item3=getItemAtIndex_7)
code_block_41 = CodeBlock { 6; }
getItemAtIndex_8 = List.GetItemAtIndex(list=data_shapes_ui_multipleinputform.User_Inputs, index=code_block_41)
code_block_42 = CodeBlock { 7; }
getItemAtIndex_9 = List.GetItemAtIndex(list=data_shapes_ui_multipleinputform.User_Inputs, index=code_block_42)

# group: Get naming Params
code_block_43 = CodeBlock { "File Name - Project Code"; }
getParameterValueByName_5 = Element.GetParameterValueByName(element=getItemAtIndex, parameterName=code_block_43)
code_block_44 = CodeBlock { "File Name - Originator"; }
getParameterValueByName_6 = Element.GetParameterValueByName(element=getItemAtIndex, parameterName=code_block_44)
code_block_45 = CodeBlock { "File Name - Zone"; }
getParameterValueByName_7 = Element.GetParameterValueByName(element=getItemAtIndex, parameterName=code_block_45)
code_block_46 = CodeBlock { "File Name - Level"; }
getParameterValueByName_8 = Element.GetParameterValueByName(element=getItemAtIndex, parameterName=code_block_46)
code_block_47 = CodeBlock { "File Name - Type"; }
getParameterValueByName_9 = Element.GetParameterValueByName(element=getItemAtIndex, parameterName=code_block_47)
code_block_48 = CodeBlock { "File Name - Role"; }
getParameterValueByName_10 = Element.GetParameterValueByName(element=getItemAtIndex, parameterName=code_block_48)
sheetNumber = Sheet.SheetNumber(sheet=getItemAtIndex)
sheetName = Sheet.SheetName(sheet=getItemAtIndex)
code_block_49 = CodeBlock { "Revision"; }
getParameterValueByName_11 = Element.GetParameterValueByName(element=getItemAtIndex, parameterName=code_block_49)

# group: Compile Drawing Number
code_block_50 = CodeBlock(list1=getParameterValueByName_5, list2=getParameterValueByName_6, list3=getParameterValueByName_7, list4=getParameterValueByName_8, list5=getParameterValueByName_9, list6=getParameterValueByName_10, list7=sheetNumber) { list1 + "-" + list2 + "-" + list3 + "-" + list4 + "-" + list5 + "-" + list6 + "-" + list7; }
code_block_51 = CodeBlock { "--"; }
code_block_52 = CodeBlock { "-"; }
replace = String.Replace(str=code_block_50, searchFor=code_block_51, replaceWith=code_block_52)

# group: Filename Logic
code_block_53 = CodeBlock { 0; }
getItemAtIndex_10 = List.GetItemAtIndex(list=list_create_2, index=code_block_53)
code_block_54 = CodeBlock { ""; }
if_ = If(test=getItemAtIndex_10, true=replace, false=code_block_54)
code_block_55 = CodeBlock { ""; }
operators = if_ == code_block_55
code_block_56 = CodeBlock { ""; }
code_block_57 = CodeBlock { "_"; }
operators_2 = if_ + code_block_57
if_2 = If(test=operators, true=code_block_56, false=operators_2)
flatten_3 = List.Flatten(list=if_2)

# group: Prevent directory character break
code_block_58 = CodeBlock { "/"; }
code_block_59 = CodeBlock { "+"; }
replace_2 = String.Replace(str=sheetName, searchFor=code_block_58, replaceWith=code_block_59)

# group: Filename Logic
code_block_60 = CodeBlock { 1; }
getItemAtIndex_11 = List.GetItemAtIndex(list=list_create_2, index=code_block_60)
code_block_61 = CodeBlock { ""; }
if_3 = If(test=getItemAtIndex_11, true=replace_2, false=code_block_61)
code_block_62 = CodeBlock { ""; }
operators_3 = if_3 == code_block_62
code_block_63 = CodeBlock { ""; }
code_block_64 = CodeBlock { "_"; }
operators_4 = if_3 + code_block_64
if_4 = If(test=operators_3, true=code_block_63, false=operators_4)
flatten_4 = List.Flatten(list=if_4)

# group: Filename Logic
code_block_65 = CodeBlock { 2; }
getItemAtIndex_12 = List.GetItemAtIndex(list=list_create_2, index=code_block_65)
code_block_66 = CodeBlock { ""; }
if_5 = If(test=getItemAtIndex_12, true=getParameterValueByName_11, false=code_block_66)
code_block_67 = CodeBlock { ""; }
operators_5 = if_5 == code_block_67
code_block_68 = CodeBlock { ""; }
code_block_69 = CodeBlock { "_"; }
operators_6 = if_5 + code_block_69
if_6 = If(test=operators_5, true=code_block_68, false=operators_6)
flatten_5 = List.Flatten(list=if_6)

# group: Check and write Construction Code Status and generate
code_block_70 = CodeBlock { ["S0","S1","S2","S3","S4","S6","S7","D1","D2","D3","D4","A2","A3","A4","A5","B2","B3","B4","B5","CR"]; }
flatten_6 = List.Flatten(list=code_block_70)
flatten_7 = List.Flatten(list=getItemAtIndex)
code_block_71 = CodeBlock(sheet=flatten_7) { sheet; }
titleblock_from_sheet = Python(IN[0]=code_block_71)
# ---------- titleblock_from_sheet.python (21 lines) ----------
#Alban de Chasteigner 2019
#twitter : @geniusloci_bim
#geniusloci.bim@gmail.com

import clr
# Import RevitAPI Classes
clr.AddReference('RevitAPI')
from Autodesk.Revit.DB import *

if isinstance(IN[0], list) : sheets = UnwrapElement(IN[0])
else : sheets = [UnwrapElement(IN[0])]

titleBlock=[]
for sheet in sheets:
	doc=sheet.Document
	title=FilteredElementCollector(doc,sheet.Id).OfCategory(BuiltInCategory.OST_TitleBlocks).ToElements()
	titleBlock.append(title)

#Assign your output to the OUT variable.
if isinstance(IN[0], list): OUT = titleBlock
else: OUT = titleBlock[0]
# ----------------------------------------
code_block_72 = CodeBlock(TitleBlock=titleblock_from_sheet) { TitleBlock; }
getParameterValueByName_12 = Element.GetParameterValueByName(element=code_block_72@L3, parameterName=code_block_70, lacing=Longest)
transpose = List.Transpose(lists=getParameterValueByName_12)
flatten_8 = List.Flatten(list=transpose@L3)
code_block_73 = CodeBlock { true; }
code_block_74 = CodeBlock { false; }
if_7 = If(test=flatten_8, true=code_block_73, false=code_block_74)
filterByBoolMask = List.FilterByBoolMask(list=flatten_6, mask=if_7@L2)

# group: Filename Logic
code_block_75 = CodeBlock { 3; }
getItemAtIndex_13 = List.GetItemAtIndex(list=list_create_2, index=code_block_75)
code_block_76 = CodeBlock { ""; }
if_8 = If(test=getItemAtIndex_13, true=filterByBoolMask.in, false=code_block_76)
code_block_77 = CodeBlock { ""; }
operators_7 = if_8 == code_block_77
code_block_78 = CodeBlock { ""; }
code_block_79 = CodeBlock { "_"; }
operators_8 = if_8 + code_block_79
if_9 = If(test=operators_7, true=code_block_78, false=operators_8)
flatten_9 = List.Flatten(list=if_9)

# group: Compile File Paths
get_path = Python()  # unwired: IN[0]
# ---------- get_path.python (9 lines) ----------
#Generate User Specific Path 
#PFassnidge v1.1 250920

import clr
from System import Environment

path = "C:\Users\{0}\Desktop\Print"
args = (Environment.UserName,IN[0])
OUT = path.format(*args)
# ----------------------------------------
code_block_80 = CodeBlock(DirectoryPath=get_path) { DirectoryPath; }
code_block_81 = CodeBlock(list1=flatten_3, list2=flatten_4, list3=flatten_5, list4=flatten_9) { list1 + list2 + list3 + list4; }
length = String.Length(str=code_block_81)
flatten_10 = List.Flatten(list=length)
code_block_82 = CodeBlock(x=flatten_10) { x-1; }
code_block_83 = CodeBlock { 1; }
remove = String.Remove(str=code_block_81, startIndex=code_block_82, count=code_block_83)
flatten_11 = List.Flatten(list=remove)
code_block_84 = CodeBlock(Filenames=flatten_11) { Filenames; }
code_block_85 = CodeBlock(Directorypath=code_block_80, Filename=code_block_84) { Directorypath+"\\"+Filename+".pdf"; }
code_block_86 = CodeBlock(FilePaths=code_block_85) { FilePaths; }

# group: Print
list_create_3 = List.Create(item0=getItemAtIndex)
flatten_12 = List.Flatten(list=list_create_3)
print_range = StringInput("Select")
code_block_87 = CodeBlock(PrintRange=print_range) { PrintRange; }
code_block_88 = CodeBlock { true; }
code_block_89 = CodeBlock(PrinterName=getItemAtIndex_2) { PrinterName; }
code_block_90 = CodeBlock(PrintSetting=flatten_2) { PrintSetting; }
flatten_13 = List.Flatten(list=code_block_86)
code_block_91 = CodeBlock(FilePaths=flatten_13) { FilePaths; }
count = List.Count(list=code_block_91)
ofRepeatedItem = List.OfRepeatedItem(item=code_block_90, amount=count)
flatten_14 = List.Flatten(list=ofRepeatedItem)
print_pdf = Python(IN[0]=flatten_12, IN[1]=code_block_87, IN[2]=code_block_88, IN[3]=code_block_89, IN[4]=flatten_14, IN[5]=code_block_91, IN[6]=getItemAtIndex_8)
# ---------- print_pdf.python (169 lines) ----------
#Copyright(c) 2015, Konrad K Sobon
# @arch_laboratory, http://archi-lab.net
# Revised by viktor_kuzev
# Revised by Michael Park
# Revised by Alban de Chasteigner

import clr
clr.AddReference('ProtoGeometry')
from Autodesk.DesignScript.Geometry import *

# Import Element wrapper extension methods
clr.AddReference("RevitNodes")
import Revit
clr.ImportExtensions(Revit.Elements)

# Import geometry conversion extension methods
clr.ImportExtensions(Revit.GeometryConversion)

# Import DocumentManager and TransactionManager
clr.AddReference("RevitServices")
import RevitServices
from RevitServices.Persistence import DocumentManager
from RevitServices.Transactions import TransactionManager

doc = DocumentManager.Instance.CurrentDBDocument
uiapp = DocumentManager.Instance.CurrentUIApplication
app = uiapp.Application

# Import RevitAPI
clr.AddReference("RevitAPI")
import Autodesk
from Autodesk.Revit.DB import *

import sys
pyt_path = r'C:\Program Files (x86)\IronPython 2.7\Lib'
sys.path.append(pyt_path)
import System

# The inputs to this node will be stored as a list in the IN variable.
dataEnteringNode = IN

sheets = IN[0]
pRange = System.Enum.Parse(Autodesk.Revit.DB.PrintRange, IN[1])
combined = IN[2]
printerName = IN[3]
printSettings = IN[4]
filePath = IN[5]
runIt = IN[6]

if isinstance(filePath, list):
	s_length = len(sheets)
	fp_length = len(filePath)
	if len(sheets) == len(filePath):
		pass
	else:
		filePath = filePath * (s_length / fp_length)
		if len(filePath) == len(sheets):
			pass
		else:
			OUT = "Filepaths and Sheets weren't the same length"
			exit()

elif isinstance(filePath, str):
	filepath = [filepath] * len(sheets)

if isinstance(sheets, list):
	viewSheets = []
	for i in sheets:
		viewSheets.append(UnwrapElement(i))
else:
	viewSheets = UnwrapElement(sheets)

if isinstance(printSettings, list):
	printSetting = []
	for i in printSettings:
		printSetting.append(UnwrapElement(i))
else:
	printSetting = UnwrapElement(printSettings)

TransactionManager.Instance.EnsureInTransaction(doc)
printManager = doc.PrintManager		
printSetup = printManager.PrintSetup
printManager.SelectNewPrintDriver(printerName)
if isinstance(printSettings, list):
	printSetup.CurrentPrintSetting = printSetting[0]
else:
	printSetup.CurrentPrintSetting = printSetting
printManager.Apply()
TransactionManager.Instance.TransactionTaskDone()

def PrintView(doc, sheet, pRange, printerName, combined, filePath, printSetting):
	# create view set
	viewSet = ViewSet()
	viewSet.Insert(sheet)
	# determine print range
	printManager = doc.PrintManager
	printManager.PrintRange = pRange
	printManager.Apply()
	# make new view set current
	viewSheetSetting = printManager.ViewSheetSetting
	viewSheetSetting.CurrentViewSheetSet.Views = viewSet
	# set printer
	printManager.SelectNewPrintDriver(printerName)
	printManager.Apply()
	# set combined and print to file
	if printManager.IsVirtual:
		printManager.CombinedFile = combined
		printManager.Apply()
		printManager.PrintToFile = True
		printManager.Apply()
	else:
		printManager.CombinedFile = combined
		printManager.Apply()
		printManager.PrintToFile = False
		printManager.Apply()
	# set file path
	printManager.PrintToFileName = filePath
	printManager.Apply()
	# apply print setting
	try:
		printSetup = printManager.PrintSetup
		printSetup.CurrentPrintSetting = printSetting
		printManager.Apply()
	except:
		pass
	# save settings and submit print
	TransactionManager.Instance.EnsureInTransaction(doc)
	viewSheetSetting.SaveAs("tempSetName")
	printManager.Apply()
	printManager.SubmitPrint()
	viewSheetSetting.Delete()
	TransactionManager.Instance.TransactionTaskDone()

	return True


try:
	viewSets = FilteredElementCollector(doc).OfClass(ViewSheetSet)
	for i in viewSets:
		if i.Name == "tempSetName":
			TransactionManager.Instance.EnsureInTransaction(doc)
			doc.Delete(i.Id)
			TransactionManager.Instance.ForceCloseTransaction()
		else:
			continue

	errorReport = None
	message = "Success"
	if runIt:
		if isinstance(viewSheets, list) and isinstance(printSetting, list):
			for i, j, fp in zip(viewSheets, printSetting, filePath):
				PrintView(doc, i, pRange, printerName, combined, fp, j)
		elif isinstance(viewSheets, list) and not isinstance(printSetting, list):
			for i, fp in zip(viewSheets, filePath):
				PrintView(doc, i, pRange, printerName, combined, fp, printSetting)
		elif not isinstance(viewSheets, list) and not isinstance(printSetting, list):
			PrintView(doc, viewSheets, pRange, printerName, combined, filePath[0], printSetting)
	else:
		message = "Please tick PDF box in pop up"
except:
	# if error accurs anywhere in the process catch it
	import traceback
	errorReport = traceback.format_exc()

# Assign your output to the OUT variable
if errorReport is None:
	OUT = message
else:
	OUT = errorReport
# ----------------------------------------

# group: Export
code_block_92 = CodeBlock(DirectoryPath=code_block_80) { DirectoryPath; }
code_block_93 = CodeBlock(view=flatten_12) { view; }
code_block_94 = CodeBlock(Filename=code_block_84) { Filename; }
code_block_95 = CodeBlock { SharedCoords:bool=true; }
code_block_96 = CodeBlock { MergeViews : bool = true; }
export_dwg = Python(IN[1]=code_block_92, IN[2]=code_block_93, IN[3]=code_block_94, IN[5]=code_block_95, IN[6]=code_block_96, IN[7]=getItemAtIndex_9)  # unwired: IN[0], IN[4]
# ---------- export_dwg.python (90 lines) ----------
# Copyright(c) 2016, Konrad K Sobon
# @arch_laboratory, http://archi-lab.net

# Import Element wrapper extension methods
import clr
clr.AddReference("RevitNodes")
import Revit
clr.ImportExtensions(Revit.Elements)

# Import DocumentManager and TransactionManager
clr.AddReference("RevitServices")
import RevitServices
from RevitServices.Persistence import DocumentManager

# Import RevitAPI
clr.AddReference("RevitAPI")
import Autodesk
from Autodesk.Revit.DB import *

import System
from System.Collections.Generic import *

import sys
pyt_path = r'C:\Program Files (x86)\IronPython 2.7\Lib'
sys.path.append(pyt_path)

def ProcessList(_func, _list):
    return map( lambda x: ProcessList(_func, x) if type(x)==list else _func(x), _list )

def ProcessParallelLists(_func, *lists):
	return map( lambda *xs: ProcessParallelLists(_func, *xs) if all(type(x) is list for x in xs) else _func(*xs), *lists )

def Unwrap(item):
	return UnwrapElement(item)

if isinstance(IN[0], list) : inputdoc = ProcessList(Unwrap, IN[0])
else : inputdoc = [Unwrap(IN[0])]
#Inputdoc : Part of script by Andreas Dieckmann
if inputdoc[0] == None:
	doc = DocumentManager.Instance.CurrentDBDocument
elif inputdoc[0].GetType().ToString() == "Autodesk.Revit.DB.Document":
	doc = inputdoc[0]
elif inputdoc[0].GetType().ToString() == "Autodesk.Revit.DB.RevitLinkInstance":
	doc = inputdoc[0].GetLinkDocument()
else: doc = DocumentManager.Instance.CurrentDBDocument

folderPath = IN[1]

if isinstance(IN[2], list) : views = ProcessList(Unwrap, IN[2])
else : views = [Unwrap(IN[2])]

if isinstance(IN[3], list) : names = IN[3]
else : names = [IN[3]]

if isinstance(IN[4], list) : Predef = IN[4]
else : Predef = [IN[4]]

RunIt = IN[7]

def ExportDwg(name, view, folder = folderPath):
	options = DWGExportOptions()
	if Predef[0] == None:
		pass
	else:
		options = options.GetPredefinedOptions(doc, Predef[0])
	options.SharedCoords = IN[5]
	options.MergedViews = IN[6]
	views = List[ElementId]()
	views.Add(view.Id)
	result = doc.Export(folder, name, views, options)
	return result

if RunIt:
	try:
		errorReport = None
		# run export
		ProcessParallelLists(ExportDwg, names, views)
		
	except:
		# if error accurs anywhere in the process catch it
		import traceback
		errorReport = traceback.format_exc()
else:
	errorReport = "Please tick DWG Box in pop up"

#Assign your output to the OUT variable
if errorReport == None:
	OUT = "Success"
else:
	OUT = errorReport
# ----------------------------------------

# group: Feedback message
are_your_pdf_files_created_note = Watch(print_pdf)  # "Are your PDF files created? (Note: There can be a slight lag time for PDF Files to appear in your Print Folder)"; graph output
are_your_dwg_files_created = Watch(export_dwg)  # graph output
list_create_4 = List.Create(item0=are_your_pdf_files_created_note, item1=are_your_dwg_files_created)

# group: Validate Script Run
code_block_97 = CodeBlock(x=are_your_pdf_files_created_note) { x == "Success"; }
count_2 = List.Count(list=flatten_14)
string_from_object = FromObject(obj=count_2)

# group: data
log_start_time = Python()  # unwired: IN[0]
# ---------- log_start_time.python (21 lines) ----------
#BPE data metrics by PF

import clr
import System
from System.IO import Directory

import sys
# load python
pyt_path = r'C:\Program Files (x86)\IronPython 2.7\Lib'
sys.path.append(pyt_path)

from datetime import datetime

project = IN[0]

# get the current date and time
starttime = datetime.now().strftime("%H-%M-%S")

import os

OUT = starttime
# ----------------------------------------
control = CodeBlock(passthrough=list_create_4, waitfor=log_start_time) { [passthrough,waitfor][0]; }
python_script = Python(IN[0]=control, IN[1]=log_start_time, IN[2]=code_block_97, IN[3]=string_from_object)
# ---------- python_script.python (70 lines) ----------
#HDT data analytics by PF

import clr
import sys

clr.AddReference("RevitServices")
clr.AddReference('DynamoRevitDS')
import RevitServices
from RevitServices.Persistence import DocumentManager

pyt_path = r'C:\Program Files (x86)\IronPython 2.7\Lib'
sys.path.append(pyt_path)

import clr
import System
import sys
import Dynamo 
import os

from System.IO import Directory
from System import Environment

DynamoRevit=Dynamo.Applications.DynamoRevit()

from datetime import datetime

#Get doc and dynamo stuff
doc = DocumentManager.Instance.CurrentDBDocument
app = DocumentManager.Instance.CurrentUIApplication.Application
scriptname=DynamoRevit.RevitDynamoModel.CurrentWorkspace.FileName

name=os.path.basename(scriptname)
filename,extention=os.path.splitext(name)
projinfo = doc.ProjectInformation

passthrough = IN[0]
starttime = IN[1]
runit = IN[2]
count = IN[3]
project = projinfo.Name
number = projinfo.Number
scriptname = filename
user = Environment.UserName;

# get the current date and time
datestamp = datetime.today().strftime("%Y-%m-%d")
endtime = datetime.now().strftime("%H-%M-%S")

dir = r"C:\Users\{}\Hydrock Consultants Ltd\BIM - Documents\03 Hydrock BIM Standards and Templates\07 Automation\Analytics".format(user)
dirQ = r"Q:\Office\IT Software\Dynamo\data"

# create a directory
Directory.CreateDirectory(dir)
Directory.CreateDirectory(dirQ)


# generate the file name
filename = (str(datestamp) + '_' +str(endtime) + '_' +str(project) + '_' +str(number) + '_' +str(scriptname) + '_' +str(starttime) + '_' +str(user) + '_' +str(count) + '_' + '.txt')

filenameQ = (str(datestamp) + '_' +str(endtime) + '_' +str(project) + '_' +str(number) + '_' +str(scriptname) + '_' +str(starttime) + '_' +str(user) + '_' +str(count) + '.txt')

# create the log file

if runit == True:
  logger = open(dir + '\\' + filename,'w+')
  loggerQ = open(dirQ + '\\' + filenameQ,'w+')
else:
  pass

OUT = str("Dynamo Analytics Complete")
# ----------------------------------------
dialog = Python(IN[0]=are_your_pdf_files_created_note)
# ---------- dialog.python (52 lines) ----------
# Enable Python support and load DesignScript library
import clr
clr.AddReference('RevitAPIUI')
from Autodesk.Revit.UI import TaskDialog, TaskDialogCommonButtons, TaskDialogResult, TaskDialogCommandLinkId

# Import DocumentManager and TransactionManager
clr.AddReference("RevitServices")
import RevitServices
from RevitServices.Persistence import DocumentManager
from RevitServices.Transactions import TransactionManager

CheckRun = IN[0]

if CheckRun == "Success":
  mainDialog = TaskDialog("Hydrock Digital Tools")
  mainDialog.MainInstruction = "Printing Finished"
  mainDialog.MainContent = """Success!.

  Your sheets should be printing into the folder called Print on your Desktop.

  Large numbers of sheets can take time to appear in the folder so please be patient! :-)"""

  mainDialog.CommonButtons = TaskDialogCommonButtons.Close;
  mainDialog.DefaultButton = TaskDialogResult.Close;

else:

  mainDialog = TaskDialog("Hydrock Digital Tools")
  mainDialog.MainInstruction = "Printing Finished"
  mainDialog.MainContent = """Hmm no sheets huh? 

  Maybe check: 

  i)  Do all your Sheets have a Status Code added?
  ii) Do all your Sheets have a Revision added?
  iii) Did you tick all the boxes on the options pop up?
  iv) Do you have a folder called 'Print' on your Desktop
  v) Are there sheets from your last print with the same name in the Print    
     folder? They need to be removed if so.  

  If you need support contact a member of the BIM Team

  """

  mainDialog.CommonButtons = TaskDialogCommonButtons.Close;
  mainDialog.DefaultButton = TaskDialogResult.Close;


tResult = mainDialog.Show()
OUT = tResult

TransactionManager.Instance.TransactionTaskDone()
# ----------------------------------------
